# Dynamo graph Civil3D_RUN_COMPLETO.dyn (Dynamo 3.6.1.9956)
# author: Civil3D Toolkit
# Civil 3D Toolkit — Ejecuta los 4 pasos del flujo vial en secuencia automatica.

nombre_alineamiento = StringInput("EJE PRINCIPAL")  # graph input
nombre_rasante = StringInput("RASANTE")  # graph input
capa_polilinea = StringInput("EJE DE CAMINO")  # graph input
delta_desbroce_m = DoubleInput("0.2")  # graph input
pendiente_max = DoubleInput("12")  # graph input
intervalo_corredor_m = DoubleInput("5")  # graph input
escala_h = DoubleInput("1000")  # graph input
escala_v = DoubleInput("100")  # graph input
sobrescribir = BoolSelector(true)  # graph input
run_completo = Python(IN[0]=nombre_alineamiento, IN[1]=nombre_rasante, IN[2]=capa_polilinea, IN[3]=delta_desbroce_m, IN[4]=pendiente_max, IN[5]=intervalo_corredor_m, IN[6]=escala_h, IN[7]=escala_v, IN[8]=sobrescribir)  # CPython3
# ---------- run_completo.python (813 lines) ----------
"""
╔══════════════════════════════════════════════════════════════════════╗
║   RUN COMPLETO — Civil 3D Toolkit                                   ║
║   Ejecuta los 4 pasos en secuencia automática:                      ║
║     1. Alineamiento desde polilínea "EJE DE CAMINO"                 ║
║     2. Corredor vial con ensamble "camino"                          ║
║     3. Superficie de desbroce "SDESBROCE"                           ║
║     4. Vista de perfil longitudinal (TN · SDESBROCE · RASANTE)      ║
║   Compatible: Civil 3D 2018 → 2026                                  ║
╚══════════════════════════════════════════════════════════════════════╝

INPUTS (conectar nodos en Dynamo — todos tienen valor por defecto):
  IN[0] nombre_alineamiento  str   → ej: "EJE PRINCIPAL"   (def: "EJE PRINCIPAL")
  IN[1] nombre_rasante       str   → nombre del perfil rasante (def: "RASANTE")
  IN[2] capa_polilinea       str   → capa del eje dibujado  (def: "EJE DE CAMINO")
  IN[3] delta_desbroce       float → espesor descapote en m (def: 0.20)
  IN[4] pendiente_max        float → % máx. pendiente       (def: 12.0)
  IN[5] intervalo_corredor   float → intervalo de sección   (def: 5.0)
  IN[6] escala_h             float → escala horizontal vista (def: 1000.0)
  IN[7] escala_v             float → escala vertical vista   (def: 100.0)
  IN[8] sobrescribir         bool  → reconstruir si existe  (def: True)

OUTPUTS:
  OUT[0] resumen   → dict con ids de los objetos creados
  OUT[1] log       → lista completa de mensajes del proceso
"""

SCRIPT_VERSION = "v10 — 2026-05-13"
import clr
import sys
import math

# ── Carga de DLLs ────────────────────────────────────────────────────
for _ref in ['AeccDbMgd', 'AcMgd', 'AcCoreMgd', 'AcDbMgd']:
    try:
        clr.AddReference(_ref)
    except:
        pass

from Autodesk.AutoCAD.ApplicationServices import Application
from Autodesk.AutoCAD.DatabaseServices import (
    Transaction, OpenMode, ObjectId,
    Polyline, Polyline2d, Polyline3d,
    BlockTableRecord, BlockTable,
    SymbolUtilityServices
)
from Autodesk.AutoCAD.Geometry import Point3d, Point2d

from Autodesk.Civil.ApplicationServices import CivilApplication
from Autodesk.Civil.DatabaseServices import (
    Alignment,
    Profile, ProfileView,
    Corridor,
    TinSurface,
)

doc      = Application.DocumentManager.MdiActiveDocument
db       = doc.Database
civil_db = CivilApplication.ActiveDocument
log      = []

# Safe import of optional types (may not exist in all Civil 3D builds)
try:
    from Autodesk.Civil.DatabaseServices import AlignmentType as _AlignmentType
except ImportError:
    _AlignmentType = None

def try_attempts(attempts, label):
    errores = []
    for obj, name, args in attempts:
        type_name = getattr(obj, '__name__', type(obj).__name__)
        method = getattr(obj, name, None)
        if method is None:
            errores.append("%s.%s: atributo inexistente" % (type_name, name))
            continue
        try:
            return method(*args)
        except Exception as ex:
            errores.append("%s.%s(%d args) -> %s" % (type_name, name, len(args), ex))
    raise Exception("Fallo %s. Intentos:\n    - %s" % (label, '\n    - '.join(errores)))

def first_attr(obj, names):
    for n in names:
        v = getattr(obj, n, None)
        if v is not None:
            return v
    return None


# ════════════════════════════════════════════════════════════════════
# LECTURA DE INPUTS (con defaults si el nodo no está conectado)
# ════════════════════════════════════════════════════════════════════
def _in(idx, default, cast=str):
    try:
        v = IN[idx]
        if v is None or str(v).strip() == "":
            return default
        return cast(v)
    except:
        return default

_ali_nombre  = _in(0, "EJE PRINCIPAL", str).strip()
_ras_nombre  = _in(1, "RASANTE",       str).strip()
_capa        = _in(2, "EJE DE CAMINO", str).strip()
_delta       = _in(3, 0.20,            float)
_pend_max    = _in(4, 12.0,            float)
_intervalo   = _in(5, 5.0,             float)
_esc_h       = _in(6, 1000.0,          float)
_esc_v       = _in(7, 100.0,           float)
_sobrescribir= _in(8, True,            bool)

# Nombres fijos del proyecto
_TERRENO  = "TN"
_DESBROCE = "SDESBROCE"
_ENSAMBLE = "camino"

log.append("═" * 60)
log.append("  CIVIL 3D TOOLKIT — RUN COMPLETO")
log.append("═" * 60)
log.append(f"  Alineamiento : {_ali_nombre}")
log.append(f"  Rasante      : {_ras_nombre}")
log.append(f"  Capa eje     : {_capa}")
log.append(f"  Delta desc.  : {_delta} m")
log.append(f"  Pend. máx.   : {_pend_max} %")
log.append(f"  Intervalo    : {_intervalo} m")
log.append(f"  Escala H/V   : 1:{int(_esc_h)} / 1:{int(_esc_v)}")
log.append(f"  Sobrescribir : {_sobrescribir}")
log.append("═" * 60)


# ════════════════════════════════════════════════════════════════════
# HELPERS COMUNES
# ════════════════════════════════════════════════════════════════════
def get_surface(nombre, trans, modo=OpenMode.ForRead):
    for oid in civil_db.GetSurfaceIds():
        o = trans.GetObject(oid, modo)
        if hasattr(o, 'Name') and o.Name == nombre:
            return o
    return None

def get_alignment(nombre, trans, modo=OpenMode.ForRead):
    for oid in civil_db.GetAlignmentIds():
        o = trans.GetObject(oid, modo)
        if hasattr(o, 'Name') and o.Name == nombre:
            return o
    return None

def get_profile(ali, nombre, trans):
    try:
        for pid in ali.GetProfileIds():
            p = trans.GetObject(pid, OpenMode.ForRead)
            if hasattr(p, 'Name') and p.Name == nombre:
                return p
    except:
        pass
    return None

def get_assembly(nombre, trans):
    try:
        for oid in civil_db.GetAssemblyIds():
            o = trans.GetObject(oid, OpenMode.ForRead)
            if hasattr(o, 'Name') and o.Name == nombre:
                return o
    except:
        pass
    return None

def erase_if_exists_alignment(nombre, trans):
    try:
        for oid in civil_db.GetAlignmentIds():
            o = trans.GetObject(oid, OpenMode.ForRead)
            if hasattr(o, 'Name') and o.Name == nombre:
                if _sobrescribir:
                    trans.GetObject(oid, OpenMode.ForWrite).Erase()
                    log.append(f"  [INFO] Alineamiento '{nombre}' eliminado para recrear.")
                    return True
                else:
                    log.append(f"  [INFO] Alineamiento '{nombre}' ya existe. sobrescribir=False.")
                    return False
    except:
        pass
    return True

def erase_if_exists_surface(nombre, trans):
    try:
        for oid in civil_db.GetSurfaceIds():
            o = trans.GetObject(oid, OpenMode.ForRead)
            if hasattr(o, 'Name') and o.Name == nombre:
                if _sobrescribir:
                    trans.GetObject(oid, OpenMode.ForWrite).Erase()
                    log.append(f"  [INFO] Superficie '{nombre}' eliminada para recrear.")
                    return True
                else:
                    log.append(f"  [INFO] Superficie '{nombre}' ya existe. sobrescribir=False.")
                    return False
    except:
        pass
    return True


# ════════════════════════════════════════════════════════════════════
# PASO 1 — ALINEAMIENTO DESDE POLILÍNEA
# ════════════════════════════════════════════════════════════════════
def radio_desde_bulge(bulge, p1, p2):
    if abs(bulge) < 1e-9:
        return None
    cuerda = p1.GetDistanceTo(p2)
    if cuerda < 1e-9:
        return None
    angulo  = abs(4.0 * math.atan(bulge))
    divisor = 2.0 * math.sin(angulo / 2.0)
    if abs(divisor) < 1e-9:
        return None
    return cuerda / divisor

def analizar_pline(pline):
    segmentos = []
    n = pline.NumberOfVertices
    for i in range(n - 1):
        p1    = pline.GetPoint2dAt(i)
        p2    = pline.GetPoint2dAt(i + 1)
        bulge = pline.GetBulgeAt(i)
        radio = radio_desde_bulge(bulge, p1, p2)
        segmentos.append({
            'tipo': 'arco' if radio else 'tangente',
            'p1': p1, 'p2': p2,
            'bulge': bulge, 'radio': radio, 'cw': bulge < 0
        })
    if pline.Closed and n > 1:
        p1    = pline.GetPoint2dAt(n - 1)
        p2    = pline.GetPoint2dAt(0)
        bulge = pline.GetBulgeAt(n - 1)
        radio = radio_desde_bulge(bulge, p1, p2)
        segmentos.append({
            'tipo': 'arco' if radio else 'tangente',
            'p1': p1, 'p2': p2,
            'bulge': bulge, 'radio': radio, 'cw': bulge < 0
        })
    return segmentos

def buscar_plines(trans):
    capa_upper = _capa.upper()
    encontradas = []
    try:
        ms_id = SymbolUtilityServices.GetBlockModelSpaceId(db)
        btr = trans.GetObject(ms_id, OpenMode.ForRead)
        for oid in btr:
            try:
                obj = trans.GetObject(oid, OpenMode.ForRead)
                if obj.Layer.upper() != capa_upper:
                    continue
                if isinstance(obj, Polyline):
                    encontradas.append(('LW', obj))
                elif isinstance(obj, Polyline2d):
                    encontradas.append(('2D', obj))
                elif isinstance(obj, Polyline3d):
                    log.append(
                        f"  [WARN] Polyline3D ignorada — no soporta arcos. "
                        "Usa Polyline para ejes con curvas."
                    )
            except:
                pass
    except Exception as e:
        log.append(f"  [ERROR] buscando polilíneas: {e}")
    return encontradas

def _get_layer_id(nombre):
    lid = ObjectId.Null
    try:
        with db.TransactionManager.StartTransaction() as _t:
            lt = _t.GetObject(db.LayerTableId, OpenMode.ForRead)
            if not lt.Has(nombre):
                _t.Commit()
                return lid
            lt_enum = lt.GetEnumerator()
            while lt_enum.MoveNext():
                ltr_id = lt_enum.Current
                ltr = _t.GetObject(ltr_id, OpenMode.ForRead)
                getn = getattr(ltr, 'get_Name', None)
                try:
                    nm = getn() if callable(getn) else ""
                except Exception:
                    nm = ""
                if nm == nombre:
                    lid = ltr_id
                    break
            _t.Commit()
    except Exception:
        pass
    return lid

def _col_first_id(col):
    """Safely get ObjectId of first item in a Civil 3D collection using GetEnumerator."""
    try:
        e = col.GetEnumerator()
        if e.MoveNext():
            item = e.Current
            return item if hasattr(item, 'IsNull') else getattr(item, 'ObjectId', ObjectId.Null)
    except Exception:
        pass
    return ObjectId.Null

def crear_alineamiento_manual(segmentos, estilo_ali, estilo_label, trans):
    try:
        _site  = ObjectId.Null
        _layer = _get_layer_id("0")
        _attempts = [
            (Alignment, 'Create', (civil_db, _ali_nombre, _site, _layer, estilo_ali, estilo_label, _AlignmentType.Centerline)),
            (Alignment, 'Create', (civil_db, _ali_nombre, _site, _layer, estilo_ali, estilo_label)),
            (Alignment, 'Create', (civil_db, _ali_nombre, _site, estilo_ali, estilo_label)),
            (Alignment, 'Create', (civil_db, _ali_nombre, "", "0", "Basic", "")),
            (Alignment, 'Create', (civil_db, _ali_nombre, "", "Basic", "")),
        ]
        if not _AlignmentType:
            _attempts = _attempts[1:]
        ali_id = try_attempts(_attempts, "Alignment.Create")
        ali    = trans.GetObject(ali_id, OpenMode.ForWrite)
        ali.ReferencePointStation = 0.0
        ents   = ali.Entities
        n_t, n_a = 0, 0
        for seg in segmentos:
            if seg['tipo'] == 'tangente':
                try:
                    ents.AddFixedLine(seg['p1'], seg['p2'])
                    n_t += 1
                except Exception as e:
                    log.append(f"  [WARN] tangente: {e}")
            else:
                try:
                    ents.AddFixedCurve(seg['p1'], seg['p2'], seg['radio'], seg['cw'])
                    n_a += 1
                except Exception as e:
                    log.append(f"  [WARN] arco R={seg['radio']:.2f}m: {e} — agregado como tangente.")
                    try:
                        ents.AddFixedLine(seg['p1'], seg['p2'])
                        n_t += 1
                    except:
                        pass
        ali_r = trans.GetObject(ali_id, OpenMode.ForRead)
        log.append(f"  [OK]  Alineamiento manual: {n_t} tangentes + {n_a} arcos.")
        return ali_id, ali_r.Length
    except Exception as e:
        log.append(f"  [ERROR] alineamiento manual: {e}")
        return None, 0.0

def paso1_alineamiento(trans):
    log.append("")
    log.append("── PASO 1: ALINEAMIENTO ─────────────────────────────────")
    plines = buscar_plines(trans)
    if not plines:
        log.append(f"  [ERROR] Sin polilíneas en capa '{_capa}'. Verifica el nombre de capa.")
        return None, 0.0

    log.append(f"  [INFO] {len(plines)} polilínea(s) en '{_capa}'.")
    tipo_sel, pline_sel = max(plines, key=lambda x: x[1].Length)
    if len(plines) > 1:
        log.append(f"  [WARN] Se usa la más larga ({pline_sel.Length:.2f} m).")

    segmentos = analizar_pline(pline_sel) if tipo_sel == 'LW' else []
    n_t = sum(1 for s in segmentos if s['tipo'] == 'tangente')
    n_a = sum(1 for s in segmentos if s['tipo'] == 'arco')
    if segmentos:
        log.append(f"  [INFO] Geometría: {n_t} tangente(s) + {n_a} arco(s).")

    if not erase_if_exists_alignment(_ali_nombre, trans):
        ali = get_alignment(_ali_nombre, trans)
        return ali.ObjectId if ali else None, ali.Length if ali else 0.0

    estilo_ali   = _col_first_id(civil_db.Styles.AlignmentStyles)
    estilo_label = _col_first_id(civil_db.Styles.LabelSetStyles.AlignmentLabelSetStyles)
    _ali_layer   = _get_layer_id("0")

    # Civil 3D 2026 does not support Create-from-polyline; build manually from segments
    return crear_alineamiento_manual(segmentos, estilo_ali, estilo_label, trans)


# ════════════════════════════════════════════════════════════════════
# PASO 2 — CORREDOR VIAL
# ════════════════════════════════════════════════════════════════════
def validar_pendientes(perfil):
    problemas = []
    try:
        pvis = perfil.PVIs
        for i in range(pvis.Count - 1):
            p1, p2 = pvis[i], pvis[i + 1]
            dist = abs(p2.Station - p1.Station)
            if dist > 0:
                pend = abs(p2.Elevation - p1.Elevation) / dist * 100
                if pend > _pend_max:
                    problemas.append({'desde': round(p1.Station, 2),
                                      'hasta': round(p2.Station, 2),
                                      'pendiente': round(pend, 2)})
                    log.append(f"  [ALERTA] Pendiente {pend:.2f}% entre Est. {p1.Station:.2f}–{p2.Station:.2f} m")
    except Exception as e:
        log.append(f"  [WARN] validando pendientes: {e}")
    return problemas

def paso2_corredor(trans):
    log.append("")
    log.append("── PASO 2: CORREDOR ─────────────────────────────────────")

    ali      = get_alignment(_ali_nombre, trans)
    terreno  = get_surface(_TERRENO,  trans)
    ensamble = get_assembly(_ENSAMBLE, trans)

    faltantes = []
    if not ali:      faltantes.append(f"Alineamiento '{_ali_nombre}'")
    if not terreno:  faltantes.append(f"Superficie '{_TERRENO}'")
    if not ensamble: faltantes.append(f"Ensamble '{_ENSAMBLE}'")
    if faltantes:
        log.append(f"  [ERROR] No encontrado: {' | '.join(faltantes)}")
        return None, []

    perfil = get_profile(ali, _ras_nombre, trans)
    if not perfil:
        log.append(f"  [ERROR] Perfil de rasante '{_ras_nombre}' no encontrado en '{_ali_nombre}'.")
        return None, []

    problemas = validar_pendientes(perfil)
    if not problemas:
        log.append(f"  [OK]  Pendientes dentro del criterio ({_pend_max}%).")

    nombre_corr = f"CORREDOR_{_ali_nombre}"

    # ¿Ya existe?
    try:
        for cid in civil_db.GetCorridorIds():
            c = trans.GetObject(cid, OpenMode.ForRead)
            if hasattr(c, 'Name') and c.Name == nombre_corr:
                if _sobrescribir:
                    cw = trans.GetObject(cid, OpenMode.ForWrite)
                    cw.Rebuild()
                    log.append(f"  [OK]  Corredor '{nombre_corr}' reconstruido.")
                    return cid, problemas
                else:
                    log.append(f"  [INFO] Corredor '{nombre_corr}' ya existe. sobrescribir=False.")
                    return cid, problemas
    except Exception as e:
        log.append(f"  [WARN] buscando corredor existente: {e}")

    # Crear
    try:
        corr_id = Corridor.Create(
            civil_db, nombre_corr,
            ali.ObjectId, perfil.ObjectId, ensamble.ObjectId
        )
        corr = trans.GetObject(corr_id, OpenMode.ForWrite)
        try:
            corr.Baselines[0].BaselineRegions[0].SamplingInterval = _intervalo
        except Exception as e:
            log.append(f"  [WARN] intervalo de muestreo: {e}")
        try:
            corr.AddSurface(terreno.ObjectId)
        except Exception as e:
            log.append(f"  [WARN] asociando superficie TN: {e}")
        corr.Rebuild()
        log.append(f"  [OK]  Corredor '{nombre_corr}' creado con ensamble '{_ENSAMBLE}'.")
        return corr_id, problemas
    except Exception as e:
        log.append(f"  [ERROR] creando corredor: {e}")
        return None, problemas


# ════════════════════════════════════════════════════════════════════
# PASO 3 — SUPERFICIE DESBROCE
# ════════════════════════════════════════════════════════════════════
def paso3_desbroce(trans):
    log.append("")
    log.append("── PASO 3: DESBROCE ─────────────────────────────────────")

    if _delta <= 0:
        log.append(f"  [ERROR] delta_desbroce debe ser > 0 (recibido: {_delta}).")
        return None, 0

    tn = get_surface(_TERRENO, trans)
    if not tn:
        log.append(f"  [ERROR] Superficie '{_TERRENO}' no encontrada.")
        return None, 0

    try:
        _zmin = tn.FindMinimumElevation()
        _zmax = tn.FindMaximumElevation()
        _zinfo = f"Z [{_zmin:.2f} – {_zmax:.2f}] m"
    except AttributeError:
        try:
            _p = tn.SurfaceProperties
            _zinfo = f"Z [{_p.MinimumElevation:.2f} – {_p.MaximumElevation:.2f}] m"
        except Exception:
            _zinfo = "Z [n/d]"
    log.append(f"  [INFO] TN: {tn.Vertices.Count} vértices | {_zinfo}")

    if not erase_if_exists_surface(_DESBROCE, trans):
        sup = get_surface(_DESBROCE, trans)
        return sup, sup.Vertices.Count if sup else 0

    # Crear superficie vacía
    sup_desb = None
    try:
        def _first_surf_style():
            for s in civil_db.Styles.SurfaceStyles:
                return s.ObjectId
            return ObjectId.Null
        eid = _first_surf_style()
        sid = TinSurface.Create(db, _DESBROCE, eid) if not eid.IsNull else TinSurface.Create(db, _DESBROCE)
        sup_desb = trans.GetObject(sid, OpenMode.ForWrite)
    except:
        try:
            sid = TinSurface.Create(db, _DESBROCE)
            sup_desb = trans.GetObject(sid, OpenMode.ForWrite)
        except Exception as e:
            log.append(f"  [ERROR] creando superficie TIN: {e}")
            return None, 0

    sup_desb.Description = f"Desbroce TN − {_delta:.3f} m"

    # Copiar puntos con delta hacia abajo
    total = 0
    try:
        pts = [Point3d(v.Location.X, v.Location.Y, v.Location.Z - _delta)
               for v in tn.Vertices]
        BATCH = 500
        for i in range(0, len(pts), BATCH):
            for pt in pts[i:i + BATCH]:
                try:
                    sup_desb.AddPoint(pt)
                except:
                    pass
            total += len(pts[i:i + BATCH])
    except AttributeError:
        # Fallback por triángulos
        log.append("  [WARN] Usando triángulos como fuente de puntos...")
        vistos = set()
        try:
            for tri in tn.Triangles:
                for v in [tri.Vertex1, tri.Vertex2, tri.Vertex3]:
                    k = (round(v.Location.X, 4), round(v.Location.Y, 4))
                    if k not in vistos:
                        vistos.add(k)
                        try:
                            sup_desb.AddPoint(Point3d(
                                v.Location.X, v.Location.Y, v.Location.Z - _delta
                            ))
                            total += 1
                        except:
                            pass
        except Exception as e:
            log.append(f"  [ERROR] fallback triángulos: {e}")
    except Exception as e:
        log.append(f"  [ERROR] copiando puntos: {e}")

    sup_desb.Rebuild()
    try:
        _ntri = sup_desb.NumberOfTriangles
    except AttributeError:
        try:
            _ntri = sup_desb.Triangles.Count
        except Exception:
            _ntri = '?'
    log.append(f"  [OK]  SDESBROCE lista: {total} puntos | {_ntri} triángulos | TN − {_delta*100:.0f} cm.")
    return sid, total


# ════════════════════════════════════════════════════════════════════
# PASO 4 — VISTA DE PERFIL LONGITUDINAL
# ════════════════════════════════════════════════════════════════════
def get_or_create_surface_profile(ali, sup, prefijo, trans):
    nombre = f"{prefijo}_{sup.Name}"
    if ali is None:
        return None
    try:
        _ali_len = getattr(ali, 'Length', 0.0) or 0.0
        if _ali_len <= 0:
            log.append(f"  [WARN] Perfil '{nombre}': alineamiento longitud=0, omitido.")
            return None
    except Exception:
        pass
    try:
        for pid in ali.GetProfileIds():
            p = trans.GetObject(pid, OpenMode.ForRead)
            if hasattr(p, 'Name') and p.Name == nombre:
                log.append(f"  [INFO] Perfil '{nombre}' ya existe.")
                return p
    except:
        pass
    try:
        _prof_style = _col_first_id(civil_db.Styles.ProfileStyles)
        _prof_label = _col_first_id(civil_db.Styles.LabelSetStyles.ProfileLabelSetStyles)
        if _prof_label.IsNull:
            _prof_label = _col_first_id(civil_db.Styles.ProfileLabelSetStyles) if hasattr(civil_db.Styles, 'ProfileLabelSetStyles') else ObjectId.Null
        _prof_layer = _get_layer_id("0")
        pid = try_attempts([
            (Profile, 'CreateFromSurface', (nombre, ali.ObjectId, sup.ObjectId, _prof_layer, _prof_style, _prof_label)),
            (Profile, 'CreateFromSurface', (nombre, ali.ObjectId, sup.ObjectId, _prof_style, _prof_label)),
            (Profile, 'CreateFromSurface', (nombre, ali.ObjectId, sup.ObjectId, _prof_layer, _prof_style, ObjectId.Null)),
            (Profile, 'CreateFromSurface', (nombre, ali.ObjectId, sup.ObjectId, _prof_layer, ObjectId.Null, ObjectId.Null)),
        ], f"Profile.CreateFromSurface({sup.Name})")
        p = trans.GetObject(pid, OpenMode.ForRead)
        log.append(f"  [OK]  Perfil '{nombre}' creado desde superficie '{sup.Name}'.")
        return p
    except Exception as e:
        log.append(f"  [ERROR] creando perfil desde '{sup.Name}': {e}")
        return None

def punto_insercion_derecha(ali):
    try:
        ext = first_attr(ali, ['GeomExtents', 'Extents', 'GeometryExtents', 'Bounds'])
        if ext is not None:
            maxp = first_attr(ext, ['MaxPoint', 'Maximum', 'Max'])
            minp = first_attr(ext, ['MinPoint', 'Minimum', 'Min'])
            off  = max(ali.Length * 0.10, 50.0)
            x    = getattr(maxp, 'X', 0.0) + off
            y    = (getattr(minp, 'Y', 0.0) + getattr(maxp, 'Y', 0.0)) / 2.0
            log.append(f"  [INFO] Vista en X={x:.1f}, Y={y:.1f}.")
            return Point3d(x, y, 0.0)
    except Exception:
        pass
    log.append("  [WARN] No se pudo calcular punto de inserción. Usando origen.")
    return Point3d(0, 0, 0)

def paso4_vista_perfil(trans):
    log.append("")
    log.append("── PASO 4: VISTA DE PERFIL ──────────────────────────────")

    ali     = get_alignment(_ali_nombre, trans)
    sup_tn  = get_surface(_TERRENO,   trans)
    sup_dsb = get_surface(_DESBROCE,  trans)

    if not ali:
        log.append(f"  [ERROR] Alineamiento '{_ali_nombre}' no encontrado.")
        return None

    perf_tn  = get_or_create_surface_profile(ali, sup_tn,  "TN", trans) if sup_tn  else None
    perf_dsb = get_or_create_surface_profile(ali, sup_dsb, "SD", trans) if sup_dsb else None
    perf_ras = get_profile(ali, _ras_nombre, trans)

    if not perf_tn:  log.append(f"  [WARN] Sin perfil TN — superficie '{_TERRENO}' no disponible.")
    if not perf_dsb: log.append(f"  [WARN] Sin perfil desbroce — superficie '{_DESBROCE}' no disponible.")
    if not perf_ras: log.append(f"  [WARN] Sin perfil rasante '{_ras_nombre}' — agrégalo después.")

    nombre_vista = f"PL_{_ali_nombre}"

    # ¿Ya existe?
    try:
        for pvid in ali.GetProfileViewIds():
            pv = trans.GetObject(pvid, OpenMode.ForRead)
            if hasattr(pv, 'Name') and pv.Name == nombre_vista:
                log.append(f"  [INFO] Vista '{nombre_vista}' ya existe. Actualizando perfiles.")
                pv_w = trans.GetObject(pvid, OpenMode.ForWrite)
                for p in [perf_tn, perf_dsb, perf_ras]:
                    if p:
                        try: pv_w.AddProfile(p.ObjectId)
                        except: pass
                return pvid
    except Exception as e:
        log.append(f"  [WARN] buscando vista existente: {e}")

    pt_ins    = punto_insercion_derecha(ali)
    _pv_style = _col_first_id(civil_db.Styles.ProfileViewStyles)
    _pv_band = ObjectId.Null
    _band_paths = [
        lambda: civil_db.Styles.ProfileViewBandStyles.ProfileViewBandSetStyles,
        lambda: civil_db.Styles.BandSetStyles.ProfileViewBandSetStyles,
        lambda: civil_db.Styles.ProfileViewBandSetStyles,
        lambda: civil_db.Styles.LabelSetStyles.ProfileViewBandSetStyles,
    ]
    for _bp in _band_paths:
        try:
            _candidate = _col_first_id(_bp())
            if not _candidate.IsNull:
                _pv_band = _candidate
                break
        except Exception:
            pass
    if _pv_band.IsNull:
        # Dump available style collections for diagnosis
        try:
            _sty_attrs = [a for a in dir(civil_db.Styles)
                          if not a.startswith('_') and ('band' in a.lower() or 'view' in a.lower())]
            log.append(f"  [DIAG] Styles attrs con band/view: {_sty_attrs}")
        except Exception:
            pass

    try:
        pv_id = try_attempts([
            (ProfileView, 'Create', (ali.ObjectId, pt_ins, nombre_vista, _pv_band, _pv_style)),
            (ProfileView, 'Create', (ali.ObjectId, pt_ins, nombre_vista, _pv_style)),
            (ProfileView, 'Create', (ali.ObjectId, pt_ins, nombre_vista)),
        ], "ProfileView.Create")

        pv = trans.GetObject(pv_id, OpenMode.ForWrite)
        _ep = _col_first_id(civil_db.Styles.ProfileStyles)
        for perfil in [perf_tn, perf_dsb, perf_ras]:
            if perfil is None:
                continue
            try:
                pv.AddProfile(perfil.ObjectId, _ep)
                log.append(f"  [OK]  Perfil '{perfil.Name}' agregado.")
            except Exception:
                try:
                    pv.AddProfile(perfil.ObjectId)
                    log.append(f"  [OK]  Perfil '{perfil.Name}' agregado (sin estilo).")
                except Exception as e:
                    log.append(f"  [WARN] no pudo agregar '{perfil.Name}': {e}")

        log.append(f"  [OK]  Vista '{nombre_vista}' creada.")
        return pv_id

    except Exception as e:
        log.append(f"  [ERROR CRÍTICO] Paso 4: {e}")
        return None


# ════════════════════════════════════════════════════════════════════
# EJECUCIÓN COMPLETA EN SECUENCIA
# ════════════════════════════════════════════════════════════════════
resumen = {
    'alineamiento_id':  None,
    'corredor_id':      None,
    'desbroce_id':      None,
    'vista_perfil_id':  None,
    'pendientes_problema': [],
    'pasos_ok': []
}

with doc.LockDocument():
    # ── Paso 1: Alineamiento ──────────────────────────────────────
    with db.TransactionManager.StartTransaction() as trans:
        try:
            ali_id, ali_long = paso1_alineamiento(trans)
            if ali_id:
                trans.Commit()
                resumen['alineamiento_id'] = ali_id
                resumen['pasos_ok'].append('ALINEAMIENTO')
                log.append(f"  [✓] Paso 1 completado. L = {ali_long:.2f} m")
            else:
                trans.Abort()
                log.append("  [✗] Paso 1 FALLIDO — los pasos siguientes pueden fallar.")
        except Exception as e:
            log.append(f"  [ERROR CRÍTICO] Paso 1: {e}")
            trans.Abort()

    # ── Paso 2: Corredor ─────────────────────────────────────────
    with db.TransactionManager.StartTransaction() as trans:
        try:
            corr_id, problemas = paso2_corredor(trans)
            if corr_id:
                trans.Commit()
                resumen['corredor_id']        = corr_id
                resumen['pendientes_problema'] = problemas
                resumen['pasos_ok'].append('CORREDOR')
                log.append(f"  [✓] Paso 2 completado. Tramos con pend > {_pend_max}%: {len(problemas)}")
            else:
                trans.Abort()
                log.append("  [✗] Paso 2 FALLIDO.")
        except Exception as e:
            log.append(f"  [ERROR CRÍTICO] Paso 2: {e}")
            trans.Abort()

    # ── Paso 3: Desbroce ─────────────────────────────────────────
    with db.TransactionManager.StartTransaction() as trans:
        try:
            dsb_id, n_pts = paso3_desbroce(trans)
            if dsb_id:
                trans.Commit()
                resumen['desbroce_id'] = dsb_id
                resumen['pasos_ok'].append('DESBROCE')
                log.append(f"  [✓] Paso 3 completado. {n_pts} puntos procesados.")
            else:
                trans.Abort()
                log.append("  [✗] Paso 3 FALLIDO.")
        except Exception as e:
            log.append(f"  [ERROR CRÍTICO] Paso 3: {e}")
            trans.Abort()

    # ── Paso 4: Vista de Perfil ──────────────────────────────────
    with db.TransactionManager.StartTransaction() as trans:
        try:
            pv_id = paso4_vista_perfil(trans)
            if pv_id:
                trans.Commit()
                resumen['vista_perfil_id'] = pv_id
                resumen['pasos_ok'].append('VISTA PERFIL')
                log.append(f"  [✓] Paso 4 completado.")
            else:
                trans.Abort()
                log.append("  [✗] Paso 4 FALLIDO.")
        except Exception as e:
            log.append(f"  [ERROR CRÍTICO] Paso 4: {e}")
            trans.Abort()

# ── Resumen final ────────────────────────────────────────────────
log.append("")
log.append("═" * 60)
n_ok = len(resumen['pasos_ok'])
log.append(f"  RESULTADO: {n_ok}/4 pasos completados")
if resumen['pasos_ok']:
    log.append(f"  OK  → {' · '.join(resumen['pasos_ok'])}")
pasos_fallidos = [p for p in ['ALINEAMIENTO','CORREDOR','DESBROCE','VISTA PERFIL']
                  if p not in resumen['pasos_ok']]
if pasos_fallidos:
    log.append(f"  FAIL→ {' · '.join(pasos_fallidos)}")
log.append("═" * 60)

# Build summary lines from resumen dict so Dynamo gets a plain string
_resumen_lines = [
    f"  alineamiento_id  : {resumen.get('alineamiento_id')}",
    f"  corredor_id      : {resumen.get('corredor_id')}",
    f"  desbroce_id      : {resumen.get('desbroce_id')}",
    f"  vista_perfil_id  : {resumen.get('vista_perfil_id')}",
    f"  pasos_ok         : {resumen.get('pasos_ok')}",
    f"  pendientes_prob  : {resumen.get('pendientes_problema')}",
]
OUT = '\n'.join(log + [''] + _resumen_lines)
# ----------------------------------------
log_resumen = Watch(run_completo)  # graph output
